# Grasshopper definition 20220111_print_execute.ghx (Grasshopper 1.0.7)

panel = Panel("70*150*100 = L*W*H")
panel_2 = Panel("C:\Users\ahmed\OneDrive - Politecnico di Milano\ETH Zurich\MAS Dfab\T2_Rammed Earth\T2_Rammed_Earth_G3\Ahmed\designbozza2.py")
# Fixed directions that are hardcoded in the
# code and the geometry are directly adjusted
#  based on them
# (even if x_dir and y_dir are changed)
panel_3 = Panel("5 layers")
read_file = ReadFile(File=panel_2, PerLineParse=False)
x_div = Slider(7, range=1..20)
x_div_2 = Slider(3.75, range=0..20)
crv = Curve(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)
crv_2 = Curve(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)
X = UnitX(Factor=1)
Y = UnitY(Factor=1)
pt = Point(Point(307.3804476, 148.6418372, 0))
pt_2 = Point(Point(166.2884953, 146.5080274, 0))
ghpython_script = GhPythonScript(
    Code=read_file,
    Curve=crv,
    X_dir=X,
    Y_dir=Y,
    Ref_point_st=pt_2,
    Ref_point_end=pt,
    X_spacing=x_div,
    Threshold_dist=x_div_2,
    Type1Dist=Slider(22.809, range=15..28),
    Perp_dist_thresh=Slider(5, range=3..7))  # -> Out, Contour_pts, Main_paths, Up_factors, Sec_paths, Crv_pt_st, EndSideContourPairs, StSideContourPairs, Contour_pts_st
knob = ControlKnob(Decimals=0, Limit=True, Maximum=10, Minimum=0, Range=10, Value=0)
data = Data(ghpython_script.EndSideContourPairs)
panel_4 = Panel(ghpython_script.Out)
data_2 = Data(ghpython_script.StSideContourPairs)
data_3 = Data(ghpython_script.Crv_pt_st)
data_4 = Data(ghpython_script.Contour_pts)
data_5 = Data(ghpython_script.Contour_pts_st)
item = ListItem(List=data_5, Index=knob, Wrap=True)
number_slider = Slider(50, range=40..2000)
number_slider_2 = Slider(7.5, range=0..100)
number_slider_3 = Slider(3.5, range=0..100)

# ----
# Load classes from src
button = Button()
add_paths_from_local_dir = GhPythonScript(reload=button)  # -> dire
# ---------- add_paths_from_local_dir: Python ----------
import os
import sys

#get current file path
path = ghenv.Component.OnPingDocument().FilePath
#get parent directory of the parent directory
parentdir = os.path.dirname(os.path.dirname(path))
#go to root folder
root = os.path.dirname(parentdir)
#get src folder which contains classes
dire = os.path.join(root,'src')

print dire
#add path to sys
sys.path.append(dire)

ghenv.Component.Message = "paths added"

from compas_rhino import unload_modules

if reload:
    unload_modules("design")
    unload_modules("planning")
    
    unload_modules("ur_fabrication")
    
    ghenv.Component.Message = "paths updated"
# ---------- end add_paths_from_local_dir ----------
panel_5 = Panel(add_paths_from_local_dir)

crv_3 = Curve(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)
generate_design_from_crv = GhPythonScript(
    input_crv=crv_3,
    h_spacing=number_slider_2,
    v_spacing=number_slider_3,
    height=number_slider,
    prototype_name="straightWall",
    extra_text="Demo")  # -> points, global_design; inputs input_crv: Curve
# ---------- generate_design_from_crv: Python ----------
from design import GlobalDesign
from ghpythonlib.treehelpers import list_to_tree as _tree


prototype_identifier = prototype_name + "_" +  extra_text

global_design= GlobalDesign.design_from_curve(input_crv, h_spacing, height, v_spacing, prototype_identifier)

#generate uid
global_design.generate_uid_for_all_parts()
points = global_design.visualize()

#Convert to tree to visualize
points = _tree(points)
# ---------- end generate_design_from_crv ----------
generate_design_from_crv_2 = GhPythonScript(
    input_crv=crv_3,
    h_spacing=number_slider_2,
    v_spacing=number_slider_3,
    height=number_slider,
    prototype_name="straightWall",
    extra_text="Demo")  # -> points, global_design; inputs input_crv: Curve; same code as generate_design_from_crv
crv_4 = Curve([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])
plan_sequence = GhPythonScript(design=generate_design_from_crv.global_design, toolpath_volume=Slider(900, range=0..1000), n=Slider(0, range=0..15))  # -> sequencer, points, tool_curve, data; inputs toolpath_volume: Int32, n: Int32
# ---------- plan_sequence: Python ----------
from planning import ConstructionSequencer


sequencer = ConstructionSequencer(design, toolpath_volume)
sequencer.generate_toolpaths_continuous()

toolpath = sequencer.toolpaths[n]
toolpath.add_safety_points(setup = "UR")


points, tool_curve = toolpath.visualize_pts()
data = [toolpath.export_toolpath_to_UR(wait_time = 1.2)]
# ---------- end plan_sequence ----------
parse_data = GhPythonScript(data=plan_sequence.data)  # -> planes, toggles, wait_times
# ---------- parse_data: Python ----------
planes = data['planes']
toggles = data['toggles']
wait_times = data['wait times']
# ---------- end parse_data ----------
send_to_robot = GhPythonScript(
    planes=flatten(parse_data.planes),
    toggles=flatten(parse_data.toggles),
    waits=flatten(parse_data.wait_times),
    lift_height=Slider(18, range=0..100),
    send=Button())  # -> ur10, robot_planes, script; inputs planes: list of Plane, toggles: list of Boolean, waits: list
# ---------- send_to_robot: Python ----------
import os
import sys
import Rhino.Geometry as rg

from math import radians

from ur_fabrication import UR

ur10 = UR(planes,toggles,waits, ip = "192.168.10.20")

ur10.tcp(-86.62,-28.48,147.92,0.0,180.0, 0.0)

origin = rg.Point3d(-293.81, -673.70, 11.50) #Origin
xaxis = rg.Point3d(247.93, -677.69, 10.70) #XAxis Point
yaxis = rg.Point3d(62.22, -430.51, 7.78) #Point on +XY Plane
ur10.set_base_plane(origin, xaxis, yaxis)

ur10.prepare_script(lift_height = lift_height + 1.5)

robot_planes = ur10.robot_frames
script = ur10.script
if send:
   ur10.trigger()
# ---------- end send_to_robot ----------
panel_6 = Panel(send_to_robot.script)
