# Grasshopper definition impact_print_ver2.ghx (Grasshopper 1.0.7)
# plug-ins: treesloth01

pt = Point(Point(327.0446139, 0, 5))

# ----
# Srf
srf = Surface(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)

scale = Scale(Geometry=srf, Center=pt, Factor=Slider(1.1, range=0..10))  # -> Geometry, Transform
contour = Contour(Shape=scale.Geometry, Point=Point(0, 0, 0), Direction=Vector(0, 0, 1), Distance=Slider(4.5, range=0..10))  # -> flatten(Contours)
neg = Negative(Value=Slider(7, range=0..10))
split = SplitList(List=contour, Index=Slider(10, range=0..10))  # -> ListA, ListB
offset = OffsetCurve(Curve=split.ListA, Distance=neg, Corners=1)  # -> flatten(Curve)
# LayerAmount
# ShitDist
midpt = CurveMiddle(Curve=split.ListA)
end = EndPoints(Curve=split.ListA)  # -> Start, End

# ----
# endPtsExtend
number_slider = Slider(9, range=0..10)

shatter = Shatter(Curve=reparameterize(split.ListA), Parameters="0.5")  # -> simplify(Segments)
explode = Explode(Curve=shatter, Recursive=True)  # -> Segments, Vertices
item = ListItem(List=explode.Segments, Index=0, Wrap=True)
crv = Curve(item)
divide = DivideCurve(Curve=crv, Count=Slider(13, range=0..100), Kinks=False)  # -> Points, Tangents, Parameters
end_2 = EndPoints(Curve=crv)  # -> Start, End
item_2 = ListItem(List=divide.Points, Index=0, Wrap=True)  # -> Item1, Item
avr = Average(Input=[item_2.Item1, item_2.Item])
vec2pt = Vector2Pt(PointA=avr, PointB=item_2.Item1, Unitize=invert(False))  # -> Vector, Length
vec2pt_2 = Vector2Pt(PointA=avr, PointB=item_2.Item, Unitize=invert(False))  # -> Vector, Length
amp = Amplitude(Vector=vec2pt.Vector, Amplitude=number_slider)
amp_2 = Amplitude(Vector=vec2pt_2.Vector, Amplitude=number_slider)
move = Move(Geometry=item_2.Item1, Motion=amp)  # -> Geometry, Transform
move_2 = Move(Geometry=item_2.Item, Motion=amp_2)  # -> Geometry, Transform
merge = Merge(Data1=move.Geometry, Data2=move_2.Geometry)
lng = ListLength(List=divide.Points)
subtraction = Subtraction(A=lng, B=1)  # -> simplify(Result)
lng_2 = ListLength(List=flatten(subtraction))
repeat = RepeatData(Data="0", Length=lng_2)  # -> simplify(graft(Data))
merge_2 = Merge(Data1=subtraction, Data2=repeat)
replace = ReplaceItems(List=divide.Points, Item=merge, Indices=merge_2, Wrap=False)
intcrv = Interpolate(Vertices=replace, Degree=3, Periodic=False, KnotStyle=1)  # -> Curve, Length, Domain

# ----
# endPtsExtend
number_slider_2 = Slider(7, range=0..10)

shatter_2 = Shatter(Curve=reparameterize(offset), Parameters="0.5")  # -> simplify(Segments)
explode_2 = Explode(Curve=shatter_2, Recursive=True)  # -> Segments, Vertices
item_3 = ListItem(List=explode_2.Segments, Index=0, Wrap=True)
crv_2 = Curve(item_3)
divide_2 = DivideCurve(Curve=crv_2, Count=Slider(13, range=0..100), Kinks=False)  # -> Points, Tangents, Parameters
end_3 = EndPoints(Curve=crv_2)  # -> Start, End
item_4 = ListItem(List=divide_2.Points, Index=0, Wrap=True)  # -> Item1, Item
avr_2 = Average(Input=[item_4.Item1, item_4.Item])
vec2pt_3 = Vector2Pt(PointA=avr_2, PointB=item_4.Item1, Unitize=invert(False))  # -> Vector, Length
vec2pt_4 = Vector2Pt(PointA=avr_2, PointB=item_4.Item, Unitize=invert(False))  # -> Vector, Length
amp_3 = Amplitude(Vector=vec2pt_3.Vector, Amplitude=number_slider_2)
amp_4 = Amplitude(Vector=vec2pt_4.Vector, Amplitude=number_slider_2)
move_3 = Move(Geometry=item_4.Item1, Motion=amp_3)  # -> Geometry, Transform
move_4 = Move(Geometry=item_4.Item, Motion=amp_4)  # -> Geometry, Transform
merge_3 = Merge(Data1=move_3.Geometry, Data2=move_4.Geometry)
lng_3 = ListLength(List=divide_2.Points)
subtraction_2 = Subtraction(A=lng_3, B=1)  # -> simplify(Result)
lng_4 = ListLength(List=flatten(subtraction_2))
repeat_2 = RepeatData(Data="0", Length=lng_4)  # -> simplify(graft(Data))
merge_4 = Merge(Data1=subtraction_2, Data2=repeat_2)
replace_2 = ReplaceItems(List=divide_2.Points, Item=merge_3, Indices=merge_4, Wrap=False)
intcrv_2 = Interpolate(Vertices=replace_2, Degree=3, Periodic=False, KnotStyle=1)  # -> flatten(Curve), Length, Domain

# ----
# chunkDist
number_slider_3 = Slider(8, range=0..10)

flatten = FlattenTree(Tree=intcrv.Curve, Path="{0}")
dispatch = Dispatch(List=flatten, DispatchPattern=[True, False])  # -> ListA, ListB
item_5 = ListItem(List=flatten(intcrv.Curve), Index=0, Wrap=True)
crv_3 = Curve(dispatch.ListB)
len = Length(Curve=item_5)
end_4 = EndPoints(Curve=item_5)  # -> Start, End
division = Division(A=len, B=number_slider_3)
round = Round(Number=division)  # -> Nearest, Floor, Ceiling
ln = Line(StartPoint=end_4.Start, EndPoint=end_4.End)
divide_3 = DivideCurve(Curve=ln, Count=round.Floor, Kinks=False)  # -> Points, Tangents, Parameters
lng_5 = ListLength(List=divide_3.Points)
crv_4 = Curve(graft(dispatch.ListB))
crv_5 = Curve(graft(dispatch.ListA))
shift = ShiftList(List=divide_3.Points, Shift=1, Wrap=invert(True))  # -> simplify(graft(List))
culln = CullNth(List=divide_3.Points, CullFrequency=lng_5)  # -> simplify(graft(List))
avr_3 = Average(Input=[culln, shift])
shift_2 = ShiftPaths(Data=avr_3, Offset=-1)
yz = YZPlane(Origin=divide_3.Points)
yz_2 = YZPlane(Origin=shift_2)
pcx = CurvePlane(Curve=crv_5, Plane=yz)  # -> Points, ParamsC, ParamsP
pcx_2 = CurvePlane(Curve=crv_4, Plane=yz_2)  # -> Points, ParamsC, ParamsP
shift_3 = ShiftPaths(Data=pcx.Points, Offset=-1)
shift_4 = ShiftPaths(Data=pcx_2.Points, Offset=-1)
tstat = TreeStatistics(Tree=shift_3)  # -> Paths, Length, Count
tstat_2 = TreeStatistics(Tree=shift_3)  # -> Paths, Length, Count
series = Series(Start=0, Step="2", Count=tstat.Count)  # -> graft(Series)
series_2 = Series(Start="1", Step="2", Count=tstat_2.Count)  # -> graft(Series)
path = ConstructPath(Indices=series_2)  # -> flatten(Branch)
path_2 = ConstructPath(Indices=series)  # -> flatten(Branch)
replace_3 = ReplacePaths(Data=shift_3, Search=tstat.Paths, Replace=path_2)
replace_4 = ReplacePaths(Data=shift_4, Search=tstat_2.Paths, Replace=path)
merge_5 = Merge(Data1=replace_3, Data2=replace_4)

dispatch_2 = Dispatch(List=flatten(intcrv_2.Curve), DispatchPattern=[True, False])  # -> graft(ListA), graft(ListB)
pt_2 = Point(divide_3.Points)
pt_3 = Point(shift_2)
number_slider_4 = Slider(0.2, range=0..0.49)
len_2 = Length(Curve=dispatch_2.ListB)
len_3 = Length(Curve=dispatch_2.ListA)
addition = Addition(A="0.5", B=number_slider_4)
subtraction_3 = Subtraction(A="0.5", B=number_slider_4)
addition_2 = Addition(A="0.5", B=number_slider_4)
subtraction_4 = Subtraction(A="0.5", B=number_slider_4)
multiplication = Multiplication(A=len_2, B=subtraction_3)
multiplication_2 = Multiplication(A=len_2, B=addition)
multiplication_3 = Multiplication(A=len_3, B=subtraction_4)
multiplication_4 = Multiplication(A=len_3, B=addition_2)
eval = EvaluateLength(Curve=reparameterize(dispatch_2.ListB), Length=multiplication, Normalized=invert(True))  # -> Point, Tangent, Parameter
eval_2 = EvaluateLength(Curve=reparameterize(dispatch_2.ListB), Length=multiplication_2, Normalized=invert(True))  # -> Point, Tangent, Parameter
eval_3 = EvaluateLength(Curve=reparameterize(dispatch_2.ListA), Length=multiplication_3, Normalized=invert(True))  # -> Point, Tangent, Parameter
eval_4 = EvaluateLength(Curve=reparameterize(dispatch_2.ListA), Length=multiplication_4, Normalized=invert(True))  # -> Point, Tangent, Parameter
shatter_3 = Shatter(Curve=reparameterize(dispatch_2.ListB), Parameters=[eval_2.Parameter, eval.Parameter])
shatter_4 = Shatter(Curve=reparameterize(dispatch_2.ListA), Parameters=[eval_4.Parameter, eval_3.Parameter])
item_6 = ListItem(List=shatter_3, Index=0, Wrap=True)  # -> Item, Item1, Item2
item_7 = ListItem(List=shatter_4, Index=0, Wrap=True)  # -> Item, Item1, Item2
crv_6 = Curve(graft([item_6.Item, item_6.Item2]))
crv_7 = Curve(graft([item_7.Item, item_7.Item2]))
yz_3 = YZPlane(Origin=pt_2)
yz_4 = YZPlane(Origin=pt_3)
pcx_3 = CurvePlane(Curve=crv_6, Plane=yz_3)  # -> Points, ParamsC, ParamsP
pcx_4 = CurvePlane(Curve=crv_7, Plane=yz_4)  # -> Points, ParamsC, ParamsP
shift_5 = ShiftPaths(Data=pcx_4.Points, Offset="-2")
shift_6 = ShiftPaths(Data=pcx_3.Points, Offset="-2")
tstat_3 = TreeStatistics(Tree=shift_5)  # -> Paths, Length, Count
tstat_4 = TreeStatistics(Tree=shift_5)  # -> Paths, Length, Count
series_3 = Series(Start=0, Step="2", Count=tstat_3.Count)  # -> graft(Series)
series_4 = Series(Start="1", Step="2", Count=tstat_4.Count)  # -> graft(Series)
path_3 = ConstructPath(Indices=series_4)  # -> flatten(Branch)
path_4 = ConstructPath(Indices=series_3)  # -> flatten(Branch)
replace_5 = ReplacePaths(Data=shift_5, Search=tstat_3.Paths, Replace=path_4)
replace_6 = ReplacePaths(Data=shift_6, Search=tstat_4.Paths, Replace=path_3)
merge_6 = Merge(Data1=replace_5, Data2=replace_6)
neg_2 = Negative(Value=Slider(0, range=0..10))
item_8 = ListItem(List=flatten(avr), Index=0, Wrap=True)
Y = UnitY(Factor=neg_2)
move_5 = Move(Geometry=item_8, Motion=Y)  # -> Geometry, Transform
pt_4 = Point(graft(merge_5))
pt_5 = Point(graft(merge_6))
xz = XZPlane(Origin=move_5.Geometry)
number_slider_5 = Slider(0, range=0..21)
mirror = Mirror(Geometry=pt_4, Plane=xz)  # -> Geometry, Transform
mirror_2 = Mirror(Geometry=pt_5, Plane=xz)  # -> Geometry, Transform
merge_7 = Merge(Data1=mirror.Geometry, Data2=pt_4)
brep = Brep(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)
merge_8 = Merge(Data1=mirror_2.Geometry, Data2=pt_5)
brep_2 = Brep(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)
area = Area(Geometry=brep)  # -> Area, Centroid
cullpt = CullDuplicates(Points=merge_7, Tolerance=Slider(6, range=0..10), CullMode=3)  # -> simplify(Points), Indices, Valence
area_2 = Area(Geometry=brep_2)  # -> Area, Centroid
cullpt_2 = CullDuplicates(Points=merge_8, Tolerance=Slider(6, range=0..10), CullMode=3)  # -> simplify(Points), Indices, Valence
orient = Orient(Geometry=brep, Source=area.Centroid, Target=cullpt.Points)  # -> simplify(Geometry), Transform
orient_2 = Orient(Geometry=brep_2, Source=area_2.Centroid, Target=cullpt_2.Points)  # -> simplify(Geometry), Transform
shift_7 = ShiftPaths(Data=orient.Geometry, Offset=-1)
shift_8 = ShiftPaths(Data=orient_2.Geometry, Offset=-1)
addition_3 = Addition(A=number_slider_5, B=1)
addition_4 = Addition(A=number_slider_5, B=2)
addition_5 = Addition(A=number_slider_5, B=3)
addition_6 = Addition(A=number_slider_5, B=1)
addition_7 = Addition(A=number_slider_5, B=2)
addition_8 = Addition(A=number_slider_5, B=3)
cluster = BranchLook(data=shift_7, i=addition_3)
cluster_2 = BranchLook(data=shift_7, i=number_slider_5)
cluster_3 = BranchLook(data=shift_7, i=addition_4)
cluster_4 = BranchLook(data=shift_7, i=addition_5)
swatch = ColourSwatch(SwatchColor=RGBA(130, 130, 130, 153))
cluster_5 = BranchLook(data=shift_8, i=addition_6)
cluster_6 = BranchLook(data=shift_8, i=number_slider_5)
swatch_2 = ColourSwatch(SwatchColor=RGB(255, 122, 122))
lng_6 = ListLength(List=cluster_2)
cluster_7 = BranchLook(data=shift_8, i=addition_7)
cluster_8 = BranchLook(data=shift_8, i=addition_8)
swatch_3 = ColourSwatch(SwatchColor=RGBA(130, 130, 130, 153))
preview = CustomPreview(Geometry=orient.Geometry, Material=ColourSwatch(SwatchColor=RGB(130, 130, 130)))  # disabled
swatch_4 = ColourSwatch(SwatchColor=RGB(255, 122, 122))

preview_2 = CustomPreview(Geometry=cluster, Material=swatch_2)  # disabled
preview_3 = CustomPreview(Geometry=cluster_2, Material=swatch)  # disabled

lng_7 = ListLength(List=cluster_6)
preview_4 = CustomPreview(Geometry=cluster_3, Material=swatch)  # disabled
preview_5 = CustomPreview(Geometry=cluster_4, Material=swatch_2)  # disabled

preview_6 = CustomPreview(Geometry=cluster_5, Material=swatch_4)  # disabled
preview_7 = CustomPreview(Geometry=cluster_6, Material=swatch_3)

preview_8 = CustomPreview(Geometry=cluster_7, Material=swatch_3)  # disabled
preview_9 = CustomPreview(Geometry=cluster_8, Material=swatch_4)  # disabled
addition_9 = Addition(A=lng_6, B=lng_7)
panel = Panel(addition_9)
shift_9 = ShiftPaths(Data=cullpt_2.Points, Offset=-1)  # disabled
shift_10 = ShiftPaths(Data=cullpt.Points, Offset=-1)  # disabled
panel_2 = Panel("200")  # disabled
avr_4 = Average(Input=flatten(shift_9))  # disabled
cir = Circle(Plane=avr_4, Radius=panel_2)  # disabled
alongcrv = SortAlongCurve(Points=shift_10, Curve=cir)  # -> Points, Indices; disabled
alongcrv_2 = SortAlongCurve(Points=shift_9, Curve=cir)  # -> Points, Indices; disabled
merge_9 = Merge(Data1=alongcrv_2.Points, Data2=alongcrv.Points)  # disabled
flatten_2 = FlattenTree(Tree=merge_9, Path="{0}")  # disabled
number_slider_6 = Slider(10, range=0..10)  # disabled
avr_5 = Average(Input=flatten_2)  # disabled
number_slider_7 = Slider(111, range=0..366)  # disabled
scale_2 = Scale(Geometry=merge_9, Center=avr_5, Factor=number_slider_6)  # -> Geometry, Transform; disabled
number_slider_8 = Slider(0, range=0..9)  # disabled
brep_3 = Brep(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)  # disabled
split_2 = SplitList(List=scale_2.Geometry, Index=number_slider_7)  # -> ListA, ListB; disabled
cluster_9 = BranchLook(data=scale_2.Geometry, i=number_slider_8)  # disabled
area_3 = Area(Geometry=brep_3)  # -> Area, Centroid; disabled
pline = PolyLine(Vertices=split_2.ListA, Closed=False)  # disabled
orient_3 = Orient(Geometry=brep_3, Source=area_3.Centroid, Target=scale_2.Geometry)  # -> simplify(Geometry), Transform; disabled
pt_6 = Point(Tree({0;0}: [Point(684.4993247, 0, -157.8214286), Point(617.8652062, 55.42231747, -157.8214286), Point(551.2310878, 137.5067858, -157.8214286), Point(484.5969693, 179.0059471, -157.8214286), Point(84.79225853, 179.0061017, -157.8214286), Point(18.15814007, 137.5066531, -157.8214286)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], {1;0}: [Point(651.1822654, 0, -112.8214286), Point(584.548147, 76.80975926, -112.8214286), Point(517.9140285, 149.033466, -112.8214286), Point(51.4751993, 149.0335394, -112.8214286), Point(-15.15891916, 76.80942763, -112.8214286), Point(-81.79303762, 0, -112.8214286)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], {2;0}: [Point(617.8652062, 0, -67.82142857), Point(551.2310878, 103.7201419, -67.82142857), Point(484.5969693, 158.1685699, -67.82142857), Point(84.79225853, 158.1685886, -67.82142857), Point(18.15814007, 103.7200996, -67.82142857), Point(-48.47597839, 0, -67.82142857)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], {3;0}: [Point(584.548147, 40.19490432, -22.82142857), Point(517.9140285, 123.5148395, -22.82142857), Point(51.4751993, 123.5149456, -22.82142857), Point(-15.15891916, 40.19494988, -22.82142857), Point(-15.15891916, -40.19494988, -22.82142857), Point(51.4751993, -123.5149456, -22.82142857)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], {4;0}: [Point(617.8652062, 0, 22.17857143), Point(551.2310878, 60.00634067, 22.17857143), Point(484.5969693, 136.5471693, 22.17857143), Point(84.79225853, 136.5473605, 22.17857143), Point(18.15814007, 60.00654696, 22.17857143), Point(-48.47597839, 0, 22.17857143)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], {5;0}: [Point(584.548147, 0, 67.17857143), Point(517.9140285, 90.47660308, 67.17857143), Point(451.2799101, 146.7544994, 67.17857143), Point(118.1093178, 146.754389, 67.17857143), Point(51.4751993, 90.47642439, 67.17857143), Point(-15.15891916, 0, 67.17857143)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], {6;0}: [Point(551.2310878, 0, 112.1785714), Point(484.5969693, 113.0056675, 112.1785714), Point(84.79225853, 113.006076, 112.1785714), Point(18.15814007, 0, 112.1785714), Point(84.79225853, -113.006076, 112.1785714), Point(484.5969693, -113.0056675, 112.1785714)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], {7;0}: [Point(584.548147, 0, 157.1785714), Point(517.9140285, 48.49302627, 157.1785714), Point(451.2799101, 127.091163, 157.1785714), Point(118.1093178, 127.0911177, 157.1785714), Point(51.4751993, 48.49306509, 157.1785714), Point(-15.15891916, 0, 157.1785714)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], {8;0}: [Point(551.2310878, 0, 202.1785714), Point(484.5969693, 82.50257775, 202.1785714), Point(84.79225853, 82.50247692, 202.1785714), Point(18.15814007, 0, 202.1785714), Point(84.79225853, -82.50247692, 202.1785714), Point(484.5969693, -82.50257775, 202.1785714)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], {9;0}: [Point(517.9140285, 0, 247.1785714), Point(451.2799101, 106.0209035, 247.1785714), Point(118.1093178, 106.0208703, 247.1785714), Point(51.4751993, 0, 247.1785714), Point(118.1093178, -106.0208703, 247.1785714), Point(451.2799101, -106.0209035, 247.1785714)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]))  # disabled

# ==== cluster BranchLook: To see the condition of branch data.
data = ClusterInput()
data_2 = Data(data)
tstat = TreeStatistics(Tree=data_2)  # -> Paths, Length, Count
i = ClusterInput()
item = ListItem(List=tstat.Paths, Index=i, Wrap=True)
branch = TreeBranch(Tree=data_2, Path=item, MaintainPaths=True)
B = ClusterOutput(branch)
