# Grasshopper definition mock.ghx (Grasshopper 1.0.7)
# plug-ins: MarchingCubes, ClipperComponents

crv = Curve(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)
srf = Surface(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)
divide = DivideCurve(Curve=crv, Count=Slider(3, range=0..10), Kinks=False)  # -> Points, Tangents, Parameters
curve_charge = CurveCharge(Curve=crv, Radius=Slider(30, range=0..100), ChargeStrengths=Slider(49, range=0..100))
point_charge = PointCharge(Point=divide.Points, Radius=Slider(64, range=0..100), ChargeStrength=Slider(61, range=0..100))
cocoon = Cocoon(
    Charges=flatten([point_charge, curve_charge]),
    Iso=Slider(1, range=0..1),
    CellSize=Slider(17, range=0..100),
    Execute=Toggle(True),
    Simple=False)  # -> Mesh, RefinementData
brep = Brep(<brep referenced from the Rhino model>)
mesh = Mesh(brep)
msmooth = SmoothMesh(Mesh=cocoon.Mesh, Strength=Slider(1, range=0..10), SkipNaked=True, Iterations=Slider(17, range=0..100))
mmx = MeshMesh(MeshA=msmooth, MeshB=mesh)
divide_2 = DivideCurve(Curve=mmx, Count=Slider(37, range=0..100), Kinks=False)  # -> Points, Tangents, Parameters
intcrv = Interpolate(Vertices=divide_2.Points, Degree=3, Periodic=invert(False), KnotStyle=1)  # -> Curve, Length, Domain
polyoffset = PolylineOffset(
    Polylines=intcrv.Curve,
    Distance=Slider(7.03, range=0..100),
    Plane=Plane(origin=(0, 0, 0), x=(0, 0, 0), y=(0, 0, 0)),
    Tolerance=0.001,
    ClosedFillet=1,
    OpenFillet=1,
    Miter=2)  # -> Contour, Holes
polyoffset_2 = PolylineOffset(
    Polylines=intcrv.Curve,
    Distance=Slider(0.01, range=0..100),
    Plane=Plane(origin=(0, 0, 0), x=(0, 0, 0), y=(0, 0, 0)),
    Tolerance=0.001,
    ClosedFillet=1,
    OpenFillet=1,
    Miter=2)  # -> Contour, Holes
polyoffset_3 = PolylineOffset(
    Polylines=intcrv.Curve,
    Distance=Slider(19.16, range=0..100),
    Plane=Plane(origin=(0, 0, 0), x=(0, 0, 0), y=(0, 0, 0)),
    Tolerance=0.001,
    ClosedFillet=1,
    OpenFillet=1,
    Miter=2)  # -> Contour, Holes
divide_3 = DivideCurve(Curve=polyoffset.Holes, Count=Slider(32, range=0..100), Kinks=False)  # -> Points, Tangents, Parameters
divide_4 = DivideCurve(Curve=polyoffset_3.Holes, Count=Slider(32, range=0..100), Kinks=False)  # -> Points, Tangents, Parameters
intcrv_2 = Interpolate(Vertices=divide_3.Points, Degree=3, Periodic=invert(False), KnotStyle=1)  # -> Curve, Length, Domain
intcrv_3 = Interpolate(Vertices=divide_4.Points, Degree=3, Periodic=invert(False), KnotStyle=1)  # -> Curve, Length, Domain
divdist = DivideDistance(Curve=intcrv_3.Curve, Distance=Slider(3, range=0..10))  # -> Points, Tangents, Parameters
Z = UnitZ(Factor=1)
vrot = Rotate(Vector=divdist.Tangents, Axis=Z, Angle=degrees("270"))
line = LineSDL(Start=divdist.Points, Direction=vrot, Length=Slider(31, range=0..100))
ccx = CurveCurve(CurveA=polyoffset_2.Holes, CurveB=line)  # -> flatten(Points), ParamsA, ParamsB
ccx_2 = CurveCurve(CurveA=intcrv_2.Curve, CurveB=line)  # -> flatten(Points), ParamsA, ParamsB
pt = Point(divdist.Points)
pt_2 = Point(divdist.Points)
intcrv_4 = Interpolate(Vertices=ccx.Points, Degree=3, Periodic=invert(False), KnotStyle=1)  # -> Curve, Length, Domain
intcrv_5 = Interpolate(Vertices=ccx_2.Points, Degree=3, Periodic=invert(False), KnotStyle=1)  # -> Curve, Length, Domain
intcrv_6 = Interpolate(Vertices=pt, Degree=3, Periodic=invert(False), KnotStyle=1)  # -> Curve, Length, Domain
intcrv_7 = Interpolate(Vertices=pt_2, Degree=3, Periodic=invert(False), KnotStyle=1)  # -> Curve, Length, Domain
crv_2 = Curve(intcrv_4.Curve)
crv_3 = Curve(intcrv_5.Curve)
Z_2 = UnitZ(Factor=Slider(8, range=0..100))
Z_3 = UnitZ(Factor=Slider(92, range=0..100))
Z_4 = UnitZ(Factor=Slider(63, range=0..100))
move = Move(Geometry=crv_3, Motion=Z_2)  # -> Geometry, Transform
move_2 = Move(Geometry=intcrv_6.Curve, Motion=Z_3)  # -> Geometry, Transform
move_3 = Move(Geometry=intcrv_7.Curve, Motion=Z_4)  # -> Geometry, Transform
entwine = Entwine(Branch00=crv_2, Branch01=move.Geometry, Branch02=move_3.Geometry, Branch03=move_2.Geometry, FlattenInputs=True)  # -> flatten(Result)
loft_opt = LoftOptions(Closed=False, Adjust=False, Rebuild=0, Refit=0, Type=0)
loft = Loft(Curves=entwine, Options=loft_opt)
contour = Contour(Shape=loft, Point=Point(0, 0, 0), Direction=Vector(0, 0, 1), Distance=Slider(8, range=0..10))
