# Grasshopper definition print_execute.ghx (Grasshopper 1.0.7)

# ----
# Load classes from src
button = Button()
add_paths_from_local_dir = GhPythonScript(reload=button)  # -> dire
# ---------- add_paths_from_local_dir: Python ----------
import os
import sys

#get current file path
path = ghenv.Component.OnPingDocument().FilePath
#get parent directory of the parent directory
parentdir = os.path.dirname(os.path.dirname(path))
#go to root folder
root = os.path.dirname(parentdir)
#get src folder which contains classes
dire = os.path.join(root,'src')

print dire
#add path to sys
sys.path.append(dire)

ghenv.Component.Message = "paths added"

from compas_rhino import unload_modules

if reload:
    unload_modules("design")
    unload_modules("planning")
    
    unload_modules("ur_fabrication")
    
    ghenv.Component.Message = "paths updated"
# ---------- end add_paths_from_local_dir ----------
panel = Panel(add_paths_from_local_dir)

crv = Curve(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)
generate_design_from_crv = GhPythonScript(
    input_crv=crv,
    h_spacing=Slider(7.5, range=0..100),
    v_spacing=Slider(3.5, range=0..100),
    height=Slider(50, range=40..2000),
    prototype_name="straightWall",
    extra_text="Demo")  # -> points, global_design; inputs input_crv: Curve
# ---------- generate_design_from_crv: Python ----------
from design import GlobalDesign
from ghpythonlib.treehelpers import list_to_tree as _tree


prototype_identifier = prototype_name + "_" +  extra_text

global_design= GlobalDesign.design_from_curve(input_crv, h_spacing, height, v_spacing, prototype_identifier)

#generate uid
global_design.generate_uid_for_all_parts()
points = global_design.visualize()

#Convert to tree to visualize
points = _tree(points)
# ---------- end generate_design_from_crv ----------
crv_2 = Curve([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])
plan_sequence = GhPythonScript(design=generate_design_from_crv.global_design, toolpath_volume=Slider(900, range=0..1000), n=Slider(0, range=0..15))  # -> sequencer, points, tool_curve, data; inputs toolpath_volume: Int32, n: Int32
# ---------- plan_sequence: Python ----------
from planning import ConstructionSequencer


sequencer = ConstructionSequencer(design, toolpath_volume)
sequencer.generate_toolpaths_continuous()

toolpath = sequencer.toolpaths[n]
toolpath.add_safety_points(setup = "UR")


points, tool_curve = toolpath.visualize_pts()
data = [toolpath.export_toolpath_to_UR(wait_time = 1.2)]
# ---------- end plan_sequence ----------
parse_data = GhPythonScript(data=plan_sequence.data)  # -> planes, toggles, wait_times
# ---------- parse_data: Python ----------
planes = data['planes']
toggles = data['toggles']
wait_times = data['wait times']
# ---------- end parse_data ----------
send_to_robot = GhPythonScript(
    planes=flatten(parse_data.planes),
    toggles=flatten(parse_data.toggles),
    waits=flatten(parse_data.wait_times),
    lift_height=Slider(18, range=0..100),
    send=Button())  # -> ur10, robot_planes, script; inputs planes: list of Plane, toggles: list of Boolean, waits: list
# ---------- send_to_robot: Python ----------
import os
import sys
import Rhino.Geometry as rg

from math import radians

from ur_fabrication import UR

ur10 = UR(planes,toggles,waits, ip = "192.168.10.20")

ur10.tcp(-86.62,-28.48,147.92,0.0,180.0, 0.0)

origin = rg.Point3d(-293.81, -673.70, 11.50) #Origin
xaxis = rg.Point3d(247.93, -677.69, 10.70) #XAxis Point
yaxis = rg.Point3d(62.22, -430.51, 7.78) #Point on +XY Plane
ur10.set_base_plane(origin, xaxis, yaxis)

ur10.prepare_script(lift_height = lift_height + 1.5)

robot_planes = ur10.robot_frames
script = ur10.script
if send:
   ur10.trigger()
# ---------- end send_to_robot ----------
panel_2 = Panel(send_to_robot.script)
